# Grasshopper definition test1.gh (Grasshopper 1.0.7)

file_path = FilePath("C:\Users\gyula.karli\DEV\RhinoPythonTest\test.py")
ghpython_script = GhPythonScript(Code=file_path)  # -> Out, A
panel = Panel(ghpython_script.Out)
